# Grasshopper definition viz_4_compas_ghpython.ghx (Grasshopper 1.0.7)

python = GhPythonScript(redraw=Button())  # -> out, pts, crcls, radii
# ---------- python: Python ----------
from random import random
from compas.geometry import pointcloud_xy
from compas.utilities import i_to_green
from compas.utilities import i_to_red

import compas_ghpython
from Rhino.Geometry import Circle
from Rhino.Geometry import Point3d, Plane, Vector3d


def draw_circles(circles):
    rg_circles = []
    for c in iter(circles):
        point, normal = c['plane']
        radius = c['radius']
        rg_circles.append(Circle(Plane(Point3d(*point), Vector3d(*normal)), radius))
    return rg_circles


cloud = pointcloud_xy(20, (0, 10), (0, 5))

points = []
circles = []
radii = []

for xyz in cloud:
    n = random()
    points.append({'pos': xyz, 'color': i_to_red(n)})
    circles.append({'plane': [xyz, [0,0,1]], 'color': i_to_red(n), 'radius':n})
    radii.append(n)


pts = compas_ghpython.draw_points(points)
crcls = draw_circles(circles)
# ---------- end python ----------
pt = Point(python.pts)
circle = Circle(python.crcls)
brep = Brep(circle)
sph = Sphere(Base=pt, Radius=python.radii)
preview = CustomPreview(Geometry=brep, Material=ColourSwatch(SwatchColor=RGBA(255, 112, 112, 108)))
